# Dynamo graph Elements to Graph Database.dyn (Dynamo 2.0.2.6826)

# group: Select Category
categories = Categories(index=344)  # graph input

file_path = Filename(".\test.sparql")

# group: Get Spaces
categories_2 = Categories(index=447)  # graph input
all_elements_of_category = ElementsOfCategory(Category=categories_2)
code_block = CodeBlock { "IfcGUID"; }
getParameterValueByName = Element.GetParameterValueByName(element=all_elements_of_category, parameterName=code_block)

# group: Geometry intersection with rooms
all_elements_of_category_2 = ElementsOfCategory(Category=categories)
geometry = Element.Geometry(element=all_elements_of_category_2)
geometry_2 = Element.Geometry(element=all_elements_of_category)
flatten = List.Flatten(list=geometry_2)
doesIntersect = Geometry.DoesIntersect(geometry=geometry, other=flatten, lacing=CrossProduct)

getParameterValueByName_2 = Element.GetParameterValueByName(element=all_elements_of_category_2, parameterName=code_block)
watch = Watch(all_elements_of_category_2)
remove_empty = Python(IN[0]=watch)
# ---------- remove_empty.python (20 lines) ----------
import clr

clr.AddReference('RevitAPI')
from Autodesk.Revit.DB import *

clr.AddReference('RevitAPIIFC')
from Autodesk.Revit.DB.IFC import *

#The inputs to this node will be stored as a list in the IN variables.
elements = IN[0]

newList = []
for e in elements:
	try:
		id = ExporterIFCUtils.CreateAlternateGUID(e)
		newList.append(id)
	except:
		newList.append(e.UniqueId)

OUT = newList
# ----------------------------------------
string_from_object = FromObject(obj=remove_empty)
get_guid = Python(IN[0]=all_elements_of_category)  # same code as remove_empty

# group (continued): Get Spaces
watch_2 = Watch(get_guid)
count = List.Count(list=all_elements_of_category_2)
ofRepeatedItem = List.OfRepeatedItem(item=watch_2, amount=count)

# group: Check Intersection
code_block_2 = CodeBlock { 2; }
flatten_2 = List.Flatten(list=doesIntersect, amt=code_block_2)
code_block_3 = CodeBlock { 2; }
flatten_3 = List.Flatten(list=ofRepeatedItem, amt=code_block_3)
boolean = BoolSelector(true)  # graph input
true_false = Python(IN[0]=flatten_2, IN[1]=flatten_3, IN[2]=boolean)
# ---------- true_false.python (11 lines) ----------
#Select True False

output=[]

for a,b in zip(IN[0],IN[1]):
		if a == IN[2]:
			output.append(b)
		else:
			output.append("")

OUT = output
# ----------------------------------------
count_2 = List.Count(list=watch_2)
chop = List.Chop(list=true_false, lengths=count_2)

remove_empty_2 = Python(IN[0]=chop)
# ---------- remove_empty_2.python (18 lines) ----------
import clr
import sys

clr.AddReference('ProtoGeometry')
from Autodesk.DesignScript.Geometry import *
#The inputs to this node will be stored as a list in the IN variables.
list = IN[0]

newList = []

for i,item in enumerate(list):
	spaceList = []
	for item2 in list[i]:
		if(item2 != ''):
			spaceList.append(item2)
	newList.append(spaceList)

OUT = newList
# ----------------------------------------

# group: Create query
triples = CodeBlock { [["p", "http://web-bim/projects/1/arch/pipes/"],["sp", "http://web-bim/projects/1/arch/spaces/"],["int", "http://web-bim/projects/1/arch/interfaces/"],["bot", "https://w3id.org/bot#"],["pip", "https://example.org/pip#"]]; }
triple_creator = Python(IN[0]=string_from_object, IN[1]=remove_empty_2)
# ---------- triple_creator.python (23 lines) ----------
import clr
clr.AddReference('ProtoGeometry')
from Autodesk.DesignScript.Geometry import *
import itertools
#The inputs to this node will be stored as a list in the IN variables.
PipeIDs = IN[0]
SpaceIDs=IN[1]

#ZIP=zip(PipeIDs,SpaceIDs)
someList = []

for idx, val in enumerate(PipeIDs):
	for val2 in SpaceIDs[idx]:
		x = 'int:' + val + val2+'\n\t a pip:PipeZoneInterface;\n\t pip:touchesPipe int:'+val+';\n\t pip:touchesZone sp:'+val2+'.' 
		someList.append(x)
		
		



OUT=someList
#OUT=list(itertools.chain.from_iterable(ZIP))
#Assign your output to the OUT variable.
# ----------------------------------------
watch_3 = Watch(triple_creator)
insert_query_generator = Python(IN[0]=triples, IN[1]=watch_3)
# ---------- insert_query_generator.python (24 lines) ----------
import clr
import sys

clr.AddReference('ProtoGeometry')
from Autodesk.DesignScript.Geometry import *
#The inputs to this node will be stored as a list in the IN variables.
prefixes = IN[0]
triples = IN[1]

# Convert prefixes to string
pfx = ''.join('PREFIX %s:\t<%s>\n' % (item[0], item[1]) for item in prefixes)

# Convert triples to string
tpl = ''.join('\t%s \n' % item for item in triples)

graph = '<http://localhost:8080/projects/1/mep>'

# Query
q = '%s\n'\
	'INSERT DATA {\n'\
	'\tGRAPH %s {\n'\
	'%s}}' % (pfx, graph, tpl)

OUT = q
# ----------------------------------------

writeText = FileSystem.WriteText(filePath=file_path, text=insert_query_generator)

# group: Load into triplestore
URL = StringInput("10.2.44.41:3030")  # graph input
DB = StringInput("1")  # graph input
code_block_4 = CodeBlock { admin; }  # unwired: admin
go = BoolSelector(true)  # graph input
post_data = Python(IN[0]=URL, IN[1]=DB, IN[2]=code_block_4, IN[3]=code_block_4, IN[4]=insert_query_generator, IN[5]=go)
# ---------- post_data.python (50 lines) ----------
import clr
import sys
sys.path.append('C:\Program Files (x86)\IronPython 2.7\Lib')
import httplib, urllib, json, base64, time

clr.AddReference('ProtoGeometry')
from Autodesk.DesignScript.Geometry import *
#The inputs to this node will be stored as a list in the IN variables.
url = IN[0]
db = IN[1]
user = IN[2]
password = IN[3]
query = IN[4]
go = IN[5]

if go:

    #DB CONNECTION

    # Establish connection
    conn = httplib.HTTPConnection(url)

    # Encode username and password in base64
    encodedAuth = base64.b64encode('%s:%s' % (user, password))

    # Define headers for authorizatio etc.
    headers = {"authorization": ("Basic %s" % encodedAuth), "Content-type": "application/x-www-form-urlencoded", "Accept": "text/boolean"}

    # Define parameters (qyery, reasoning etc.)
    body = 'query=%s' % query
    params = urllib.urlencode({'update': query})

    # Send request
    #conn.request('POST', '/'+ db +'/update', body, headers)
    conn.request('POST', '/'+ db +'/update', params, headers)

    # Get response
    response = conn.getresponse()

    # Read response
    data = response.status, response.reason

    # Close db connection
    conn.close()

else:
    data = "off mode"

#Assign your output to the OUT variable.
OUT = data
# ----------------------------------------
watch_4 = Watch(post_data)
